# Grasshopper definition Painel_Victor.gh (Grasshopper 1.0.7)

number_slider = Slider(50, range=2..500)  # disabled
number_slider_2 = Slider(8, range=2..500)  # disabled
srf = Surface(<surface referenced from the Rhino model>)
srf_2 = Surface(<surface referenced from the Rhino model>)  # disabled
sdivide = DivideSurface(Surface=srf, UCount=Slider(30, range=2..500), VCount=Slider(8, range=2..500))  # -> Points, Normals, Parameters
sdivide_2 = DivideSurface(Surface=srf_2, UCount=number_slider, VCount=number_slider_2)  # -> Points, Normals, Parameters; disabled
intcrv_t = InterpolateT(Vertices=sdivide_2.Points, TangentStart=Vector(0, 0, 0), TangentEnd=Vector(0, 0, 0), KnotStyle=1)  # -> Curve, Length, Domain; disabled
item = ListItem(List=sdivide.Normals, Index=0, Wrap=True)
Z = UnitZ(Factor=1)  # disabled
item_2 = ListItem(List=sdivide.Points, Index=0, Wrap=True)
item_3 = ListItem(List=sdivide_2.Normals, Index=0, Wrap=True)  # disabled
panel = Panel(item_3)  # disabled
intcrv_t_2 = InterpolateT(Vertices=sdivide.Points, TangentStart=Vector(0, 0, 0), TangentEnd=Vector(0, 0, 0), KnotStyle=1)  # -> Curve, Length, Domain
item_4 = ListItem(List=sdivide_2.Points, Index=0, Wrap=True)  # disabled
xprod = CrossProduct(VectorA=item_3, VectorB=Z, Unitize=False)  # -> Vector, Length; disabled
end = EndPoints(Curve=intcrv_t_2.Curve)  # -> Start, End
devec = DeconstructVector(Vector=item)  # -> XComponent, YComponent, ZComponent
number_slider_3 = Slider(0.2, range=0..1)  # disabled
number_slider_4 = Slider(0.1, range=0..1)  # disabled
pl = ConstructPlane(Origin=flatten(item_4), XAxis=flatten(item_3), YAxis=flatten(xprod.Vector))  # disabled

# ---- group: extrusão
neg = Negative(Value=devec.XComponent)
vec = VectorXYZ(XComponent=devec.YComponent, YComponent=neg, ZComponent="0")  # -> Vector, Length
amp = Amplitude(Vector=vec.Vector, Amplitude=Slider(0.2, range=0..2))

# ----
ln = Line(StartPoint=end.Start, EndPoint=end.End)

vec_2 = VectorXYZ(XComponent=devec.XComponent, YComponent=devec.YComponent, ZComponent="0")  # -> Vector, Length
neg_2 = Negative(Value=Slider(0.68, range=0..2))
amp_2 = Amplitude(Vector=vec_2.Vector, Amplitude=neg_2)

rectangle = Rectangle(Plane=pl, XSize=number_slider_4, YSize=number_slider_3, Radius=0)  # -> Rectangle, Length; disabled
swp1 = Sweep1(Rail=intcrv_t.Curve, Sections=graft(rectangle.Rectangle), Miter=1)  # disabled
vdis = VectorDisplay(Anchor=item_2, Vector=vec_2.Vector)
move = Move(Geometry=ln, Motion=amp_2)  # -> Geometry, Transform
merge = Merge(Data1=move.Geometry, Data2=intcrv_t_2.Curve)
loft = Loft(Curves=merge, Options={Adjust=False, Closed=False, LoftEnds=0, LoftSimp=0, LoftType=0, Rebuild=10, Refit=0.01})
planar = IsPlanar(Surface=loft, Interior=True)  # -> Planar, Plane
extr = Extrude(Base=loft, Direction=amp)
panel_2 = Panel(planar.Planar)
